# Grasshopper definition HopsTest.gh (Grasshopper 1.0.7)

number_slider = Slider(8, range=0..10)
get_integer = GetInteger(number_slider, AtLeast=1, AtMost=1, Maximum=2147483647, Minimum=-2147483648, TreeAccess=False)
_2 = GetInteger(Slider(5, range=0..10), AtLeast=1, AtMost=1, Maximum=2147483647, Minimum=-2147483648, TreeAccess=False)
addition = Addition(A=_2, B=get_integer)
context_print = ContextPrint(Text=addition)
