# Grasshopper definition HopsTest2.gh (Grasshopper 1.0.8)

int2 = Slider(8, range=0..10)
int1 = Slider(5, range=0..10)
get_integer = GetInteger(int2, AtLeast=1, AtMost=1, Maximum=2147483647, Minimum=-2147483648, TreeAccess=False)
_2 = GetInteger(int1, AtLeast=1, AtMost=1, Maximum=2147483647, Minimum=-2147483648, TreeAccess=False)
addition = Addition(A=_2, B=get_integer, C="5")
context_print = ContextPrint(Text=addition)
