# Grasshopper definition HopsTest3.gh (Grasshopper 1.0.8)

int2 = Slider(8, range=0..10)
int1 = Slider(5, range=0..10)
int2_2 = GetInteger(int2, AtLeast=1, AtMost=1, Maximum=2147483647, Minimum=-2147483648, TreeAccess=False)
int1_2 = GetInteger(int1, AtLeast=1, AtMost=1, Maximum=2147483647, Minimum=-2147483648, TreeAccess=False)
addition = Addition(A=int1_2, B=int2_2, C="5")
context_print = ContextPrint(Text=addition)
